# Grasshopper definition TCPServer.gh (Grasshopper 1.0.8)
# plug-ins: RhinoCodePluginGH

Z = UnitZ(Factor=Slider(50, range=0..100))
mesh = Mesh(<mesh referenced from the Rhino model>)
move = Move(Geometry=mesh, Motion=Z)  # -> Geometry, Transform
int = Integer(8080)
panel = Panel(int)
c_script = CSharpScript(Port=int, inputMesh=move.Geometry, Enabled=Toggle(True))  # -> Status, Status_2, Connections; inputs Port: Int32, inputMesh: Mesh, Enabled: Boolean
# ---------- c_script: C# ----------
// Grasshopper Script Instance
#region Usings
using System;
using System.Net;
using System.Net.Sockets;
using System.Text;
using System.Threading;
using System.Collections.Generic;
using Rhino.Geometry;
using Grasshopper;
#endregion

public class Script_Instance : GH_ScriptInstance
{
    #region Members
    private TcpListener server = null;
    private TcpClient client = null;
    private Thread serverThread = null;
    private bool isRunning = false;
    private string clientInfo = "Disconnected";
    #endregion

    private void RunScript(
	int Port,
	Mesh inputMesh,
	bool Enabled,
	ref object Status,
	ref object Connections)
{
    // Start or stop the server based on Enabled input
    if (Enabled && !isRunning)
    {
        StartServer(Port);
        Status = "Server started";
    }
    else if (!Enabled && isRunning)
    {
        StopServer();
        Status = "Server stopped";
    }
    else if (isRunning)
    {
        Status = "Server is already running";
    }
    else
    {
        Status = "Server is stopped";
    }

    // Update Connections based on client connection state
    Connections = clientInfo;

    // Send mesh data if the server is running and a client is connected
    if (isRunning && client != null && client.Connected && inputMesh != null)
    {
        string meshData = SerializeMesh(inputMesh);
        SendMessage(meshData);
    }
}

    // Method to start the server
    private void StartServer(int port)
    {
        try
        {
            server = new TcpListener(IPAddress.Any, port);
            server.Start();
            isRunning = true;

            serverThread = new Thread(new ThreadStart(ListenForClients));
            serverThread.Start();

            Print("TCP Server started on port " + port.ToString());
        }
        catch (Exception e)
        {
            Print("Error starting server: " + e.Message);
        }
    }

    // Method to listen for client connections
    private void ListenForClients()
    {
        try
        {
            while (isRunning)
            {
                client = server.AcceptTcpClient();

                // Capture client IP and port details
                IPEndPoint clientEndPoint = client.Client.RemoteEndPoint as IPEndPoint;
                if (clientEndPoint != null)
                {
                    clientInfo = $"Connected to {clientEndPoint.Address}:{clientEndPoint.Port}";
                }
                else
                {
                    clientInfo = "Connected (Unknown client details)";
                }

                Print(clientInfo); // Log the connection details

                // Handle communication in a new thread
                Thread clientThread = new Thread(() => HandleClient(client));
                clientThread.Start();
            }
        }
        catch (Exception e)
        {
            Print("Error in ListenForClients: " + e.Message);
        }
    }

    // Method to handle communication with a connected client
    private void HandleClient(TcpClient client)
    {
        NetworkStream stream = client.GetStream();
        byte[] buffer = Encoding.ASCII.GetBytes("Welcome to Rhino TCP Server!");

        // Send welcome message
        stream.Write(buffer, 0, buffer.Length);
        Print("Sent welcome message to client.");

        // Receive messages
        while (client.Connected)
        {
            try
            {
                buffer = new byte[1024];
                int bytesRead = stream.Read(buffer, 0, buffer.Length);
                if (bytesRead == 0) break;

                string receivedData = Encoding.ASCII.GetString(buffer, 0, bytesRead);
                Print("Received from client: " + receivedData);

                // Echo back the received message
                stream.Write(buffer, 0, bytesRead);
            }
            catch (Exception e)
            {
                Print("Error in HandleClient: " + e.Message);
                break;
            }
        }

        client.Close();
        clientInfo = "Disconnected"; // Update connection status on disconnect
        Print("Client disconnected.");
    }

// Method to serialise mesh data as JSON
private string SerializeMesh(Mesh mesh)
{
    StringBuilder jsonBuilder = new StringBuilder();
    jsonBuilder.Append("{");

    // Serialize vertices
    jsonBuilder.Append("\"vertices\": [");
    for (int i = 0; i < mesh.Vertices.Count; i++)
    {
        Point3d vertex = mesh.Vertices[i];
        jsonBuilder.AppendFormat("[{0}, {1}, {2}]", vertex.X, vertex.Y, vertex.Z);
        if (i < mesh.Vertices.Count - 1) jsonBuilder.Append(", ");
    }
    jsonBuilder.Append("],");

    // Serialize faces
    jsonBuilder.Append("\"faces\": [");
    for (int i = 0; i < mesh.Faces.Count; i++)
    {
        MeshFace face = mesh.Faces[i];
        if (face.IsQuad)
        {
            jsonBuilder.AppendFormat("[{0}, {1}, {2}, {3}]", face.A, face.B, face.C, face.D);
        }
        else
        {
            jsonBuilder.AppendFormat("[{0}, {1}, {2}]", face.A, face.B, face.C);
        }
        if (i < mesh.Faces.Count - 1) jsonBuilder.Append(", ");
    }
    jsonBuilder.Append("]");

    jsonBuilder.Append("}");
    return jsonBuilder.ToString();
}


    // Method to send a message to the connected client
    private void SendMessage(string message)
    {
        if (client == null || !client.Connected)
        {
            Print("No client connected to send message.");
            return;
        }

        try
        {
            NetworkStream stream = client.GetStream();
            byte[] buffer = Encoding.ASCII.GetBytes(message);
            stream.Write(buffer, 0, buffer.Length);
            Print("Sent mesh data to client.");
        }
        catch (Exception e)
        {
            Print("Error sending message: " + e.Message);
        }
    }

    // Method to stop the server
    private void StopServer()
    {
        if (!isRunning) return;

        isRunning = false;
        if (server != null) server.Stop();
        if (serverThread != null) serverThread.Join();

        clientInfo = "Disconnected"; // Reset connection status on server stop
        Print("Server stopped.");
    }

    // Ensure the server stops when Grasshopper solution expires
    ~Script_Instance()
    {
        StopServer();
    }
}
# ---------- end c_script ----------
panel_2 = Panel(c_script.Status)
panel_3 = Panel(c_script.Status_2)
panel_4 = Panel(c_script.Connections)
